# Grasshopper definition 渐变纹理.gh (Grasshopper 1.0.7)
# plug-ins: Human, LunchBox, Pufferfish

number_slider = Slider(1, range=0..10)
multiplication = Multiplication(A=Slider(1, range=0..10), B="360")
division = Division(A=multiplication, B=number_slider)
addition = Addition(A=Slider(12, range=1..20), B=1)
division_2 = Division(A=division, B=addition)
division_3 = Division(A=division, B=division_2)
series = Series(Start=0, Step=number_slider, Count=division)
multiplication_2 = Multiplication(A=number_slider, B=division_3)
subtraction = Subtraction(A=division_3, B="1")
multiplication_3 = Multiplication(A=number_slider, B=subtraction)
multiplication_4 = Multiplication(A=series, B=number_slider)
multiplication_5 = Multiplication(A=series, B=number_slider)
number_slider_2 = Slider(10, range=0..20)
sin = Sine(Value=degrees(multiplication_5))
cos = Cosine(Value=degrees(multiplication_4))
multiplication_6 = Multiplication(A=series, B=multiplication_3)
multiplication_7 = Multiplication(A=series, B=multiplication_2)
multiplication_8 = Multiplication(A=series, B=multiplication_2)
number_slider_3 = Slider(10, range=0..20)
sin_2 = Sine(Value=degrees(multiplication_7))
cos_2 = Cosine(Value=degrees(multiplication_8))
sin_3 = Sine(Value=degrees(multiplication_6))
multiplication_9 = Multiplication(A=sin, B=number_slider_2)
multiplication_10 = Multiplication(A=cos, B=number_slider_2)
multiplication_11 = Multiplication(A=cos_2, B=number_slider_3)
multiplication_12 = Multiplication(A=sin_3, B=number_slider_3)
multiplication_13 = Multiplication(A=sin_2, B=number_slider_3)
addition_2 = Addition(A=multiplication_9, B=multiplication_13)
addition_3 = Addition(A=multiplication_10, B=multiplication_11)
pt = ConstructPoint(XCoordinate=addition_2, YCoordinate=addition_3, ZCoordinate=0)
intcrv = Interpolate(Vertices=pt, Degree=3, Periodic=True, KnotStyle=1)  # -> Curve, Length, Domain

number_slider_4 = Slider(1, range=0..10)
number_slider_5 = Slider(25, range=0..100)
multiplication_14 = Multiplication(A=Slider(1, range=0..10), B="360")
dom = ConstructDomain(DomainStart=expr("-x/2", number_slider_5), DomainEnd=expr("x/2", number_slider_5))
division_4 = Division(A=multiplication_14, B=number_slider_4)
addition_4 = Addition(A=Slider(12, range=1..20), B=1)
rectangle = Rectangle(Plane=PlaneXY(0, 0, 0), XSize=dom, YSize=dom, Radius=0)  # -> Rectangle, Length
cir = Circle(Plane=PlaneXY(0, 0, 0), Radius=expr("x/2", number_slider_5))
division_5 = Division(A=division_4, B=addition_4)
number_slider_6 = Slider(12, range=0..50)
previewlw = CustomPreviewLineweights(Geometry=cir, Shader=ColourSwatch(SwatchColor=RGB(0, 0, 0)), Thickness=Slider(3, range=0..10), Absolute=False)
division_6 = Division(A=division_4, B=division_5)
range = Range(Domain=Domain(0, 1), Steps=number_slider_6)
series_2 = Series(Start=0, Step=number_slider_4, Count=division_4)
multiplication_15 = Multiplication(A=number_slider_4, B=division_6)
cull_i = CullIndex(List=range, Indices="0", Wrap=True)
subtraction_2 = Subtraction(A=division_6, B="1")
multiplication_16 = Multiplication(A=number_slider_6, B=Slider(5, range=0..10))
graph = GraphMapper(
    cull_i,
    x0=0,
    x1=1,
    y0=0,
    y1=1,
    container_name="Bezier",
    cpx=[0, 0.3471609056, 0.6996220946, 1],
    cpy=[0.06349331141, 0.3081591725, 0.634380281, 1])
graph_2 = GraphMapper(
    cull_i,
    x0=0,
    x1=1,
    y0=0,
    y1=1,
    container_name="Bezier",
    cpx=[0, 0.4967394769, 0.8786231875, 1],
    cpy=[0, 0, 0.5126760006, 1])
multiplication_17 = Multiplication(A=number_slider_4, B=subtraction_2)
multiplication_18 = Multiplication(A=cull_i, B=Slider(1.5, range=0..3))
multiplication_19 = Multiplication(A=graph, B=Slider(11, range=0..20))
multiplication_20 = Multiplication(A=series_2, B=number_slider_4)
multiplication_21 = Multiplication(A=series_2, B=number_slider_4)
number_slider_7 = Slider(17.3, range=0..20)
number_slider_8 = Slider(0.05, range=0..0.1)
sin_4 = Sine(Value=degrees(multiplication_21))
cos_3 = Cosine(Value=degrees(multiplication_20))
cir_2 = Circle(Plane=PlaneXY(0, 0, 0), Radius=multiplication_19)
multiplication_22 = Multiplication(A=series_2, B=multiplication_17)
multiplication_23 = Multiplication(A=series_2, B=multiplication_15)
multiplication_24 = Multiplication(A=series_2, B=multiplication_15)
number_slider_9 = Slider(17.3, range=0..20)
multiplication_25 = Multiplication(A=graph_2, B=number_slider_8)
seam = Seam(Curve=reparameterize(cir_2), Seam=multiplication_18)
sin_5 = Sine(Value=degrees(multiplication_23))
cos_4 = Cosine(Value=degrees(multiplication_24))
sin_6 = Sine(Value=degrees(multiplication_22))
multiplication_26 = Multiplication(A=sin_4, B=number_slider_7)
multiplication_27 = Multiplication(A=cos_3, B=number_slider_7)
division_7 = Division(A=multiplication_25, B=Slider(4, range=0..10))
divide = DivideCurve(Curve=seam, Count=multiplication_16, Kinks=False)  # -> Points, Tangents, Parameters
multiplication_28 = Multiplication(A=cos_4, B=number_slider_9)
multiplication_29 = Multiplication(A=sin_6, B=number_slider_9)
multiplication_30 = Multiplication(A=sin_5, B=number_slider_9)
series_3 = Series(Start=number_slider_8, Step=division_7, Count=expr("x/2", multiplication_16))
addition_5 = Addition(A=multiplication_26, B=multiplication_30)
addition_6 = Addition(A=multiplication_27, B=multiplication_28)
dup = DuplicateData(Data=series_3, Number=2, Order=True)  # -> reverse(Data)
pt_2 = ConstructPoint(XCoordinate=addition_5, YCoordinate=addition_6, ZCoordinate=0)
cir_3 = Circle(Plane=divide.Points, Radius=dup)  # -> flatten(Circle)
intcrv_2 = Interpolate(Vertices=pt_2, Degree=3, Periodic=True, KnotStyle=1)  # -> Curve, Length, Domain
crv = Curve([cir, cir_3])
number_slider_10 = Slider(25, range=0..100)
number_slider_11 = Slider(25, range=0..100)
boundary = BoundarySurfaces()
srf = Surface(boundary)
subtraction_3 = Subtraction(A=number_slider_10, B=Slider(0.5, range=0..1))
subtraction_4 = Subtraction(A=number_slider_11, B=Slider(0.5, range=0..1))
dom_2 = ConstructDomain(DomainStart=expr("-x/2", number_slider_10), DomainEnd=expr("x/2", number_slider_10))
dom_3 = ConstructDomain(DomainStart=expr("-x/2", subtraction_3), DomainEnd=expr("x/2", subtraction_3))
dom_4 = ConstructDomain(DomainStart=expr("-x/2", number_slider_11), DomainEnd=expr("x/2", number_slider_11))
dom_5 = ConstructDomain(DomainStart=expr("-x/2", subtraction_4), DomainEnd=expr("x/2", subtraction_4))
preview = CustomPreview(Geometry=srf, Material=ColourSwatch(SwatchColor=RGB(255, 255, 255)))
rectangle_2 = Rectangle(Plane=PlaneXY(0, 0, 0), XSize=dom_2, YSize=dom_2, Radius=0)  # -> Rectangle, Length
rectangle_3 = Rectangle(Plane=PlaneXY(0, 0, 0), XSize=dom_3, YSize=dom_3, Radius=0)  # -> Rectangle, Length
rectangle_4 = Rectangle(Plane=PlaneXY(0, 0, 0), XSize=dom_4, YSize=dom_4, Radius=0)  # -> Rectangle, Length
rectangle_5 = Rectangle(Plane=PlaneXY(0, 0, 0), XSize=dom_5, YSize=dom_5, Radius=0)  # -> Rectangle, Length
diamond = DiamondPanels(Surface=rectangle_3.Rectangle, UDivisions=Slider(60, range=0..100), VDivisions=Slider(36, range=0..100))  # -> DiamondPanels, TriPanels
diamond_2 = DiamondPanels(Surface=rectangle_5.Rectangle, UDivisions=Slider(100, range=0..100), VDivisions=Slider(60, range=0..100))  # -> DiamondPanels, TriPanels
area = Area(Geometry=diamond.DiamondPanels)  # -> Area, Centroid
area_2 = Area(Geometry=diamond_2.DiamondPanels)  # -> Area, Centroid
pull = PullPoint(Point=area.Centroid, Geometry=intcrv_2.Curve, ClosestOnly=True)  # -> ClosestPoint, Distance
pull_2 = PullPoint(Point=area_2.Centroid, Geometry=intcrv.Curve, ClosestOnly=True)  # -> ClosestPoint, Distance
sort = SortList(Keys=pull.Distance, ValuesA=area.Centroid)  # -> Keys, ValuesA
sort_2 = SortList(Keys=pull_2.Distance, ValuesA=area_2.Centroid)  # -> Keys, ValuesA
映射 = 映射(V=sort.Keys, A=Slider(0.1, range=0..0.1), B=Slider(0.4, range=0..0.6))
映射_2 = 映射(V=sort_2.Keys, A=Slider(0.05, range=0..0.1), B=Slider(0.24, range=0..0.3))
pt_3 = ConstructPoint(XCoordinate=0, YCoordinate=0, ZCoordinate=0)
pt_4 = ConstructPoint(XCoordinate=0, YCoordinate=0, ZCoordinate=0)
vec2pt = Vector2Pt(PointA=pt_3, PointB=sort.ValuesA, Unitize=False)  # -> Vector, Length
vec2pt_2 = Vector2Pt(PointA=pt_4, PointB=sort_2.ValuesA, Unitize=False)  # -> Vector, Length
align = AlignPlane(Plane=sort.ValuesA, Direction=vec2pt.Vector)  # -> Plane, Angle
align_2 = AlignPlane(Plane=sort_2.ValuesA, Direction=vec2pt_2.Vector)  # -> Plane, Angle
ellipse = Ellipse(Plane=align.Plane, Radius1=映射, Radius2=expr("x/1.5", 映射))  # -> Ellipse, Focus1, Focus2
ellipse_2 = Ellipse(Plane=align_2.Plane, Radius1=映射_2, Radius2=expr("x/1.5", 映射_2))  # -> Ellipse, Focus1, Focus2
crv_2 = Curve(flatten([rectangle_2.Rectangle, ellipse.Ellipse]))
crv_3 = Curve(flatten([rectangle_4.Rectangle, ellipse_2.Ellipse]))
boundary_2 = BoundarySurfaces(Edges=crv_2)
dam = DataDam(DataA=crv_3, BufferDelay=10000000, BufferMode=0)
boundary_3 = BoundarySurfaces(Edges=dam)  # disabled
number_slider_12 = Slider(0.3, range=0..1)  # disabled
mesh = MeshBrep(
    Brep=boundary_3,
    Settings={GridMaxCount=0, GridMinCount=16, JaggedSeams=False, MaxEdgeLength=0, MinEdgeLength=0.0001, MinTolerance=0, Refine=True, RefineAngle=0, RelativeTolerance=0.65, SimplePlanes=True, Tolerance=0})  # disabled
preview_2 = CustomPreview(Geometry=boundary_2, Material=ColourSwatch(SwatchColor=RGB(255, 255, 255)))
offmsh = OffsetMesh(Mesh=mesh, Distance=number_slider_12, BothSides=False, CreateSolid=True)  # disabled
preview_3 = CustomPreview(Material=ColourSwatch(SwatchColor=RGB(255, 255, 255)))

# ==== cluster 映射: 区间映射
A = ClusterInput()
B = ClusterInput()
V = ClusterInput()
dom = ConstructDomain(DomainStart=A, DomainEnd=B)
bnd = Bounds(Numbers=V)  # -> flatten(Domain)
remap = RemapNumbers(Value=V, Source=bnd, Target=dom)  # -> Mapped, Clipped
R = ClusterOutput(remap.Mapped)
