# Grasshopper definition 渐变纹理2.gh (Grasshopper 1.0.7)
# plug-ins: Anemone, Hare, Human

number_slider = Slider(25, range=0..100)
number_slider_2 = Slider(3, range=0..10)
number_slider_3 = Slider(3.4, range=0..100)
dom = ConstructDomain(DomainStart=expr("-x/2", number_slider), DomainEnd=expr("x/2", number_slider))
rectangle = Rectangle(Plane=PlaneXY(0, 0, 0), XSize=dom, YSize=dom, Radius=0)  # -> Rectangle, Length
cir = Circle(Plane=PlaneXY(0, 0, 0), Radius=expr("x/2", number_slider))
python = GhPythonScript(x=number_slider_2, y=number_slider_3)  # -> out, a
# ---------- python: Python ----------
def my_gcd(a_val, b_val):
    a_val, b_val = abs(int(a_val)), abs(int(b_val))
    while b_val:
        a_val, b_val = b_val, a_val % b_val
    return a_val

def get_denominator(decimal):
    decimal_str = str(decimal)
    
    if '.' in decimal_str:
        parts = decimal_str.split('.')
        integer_part = parts[0]
        decimal_part = parts[1]
        
        denominator = 10 ** len(decimal_part)
        numerator = int(integer_part + decimal_part)
        
        gcd_val = my_gcd(numerator, denominator)
        return denominator // gcd_val
    else:
        return 1

# Main logic - 使用不同的变量名避免冲突
if x is not None and y is not None:
    input_a = x  # 大圆参数a
    input_b = y  # 小圆参数b
    
    q = get_denominator(input_b)
    a = q  # 输出到第一个端口a
else:
    a = 1  # 默认值
# ---------- end python ----------
multiplication = Multiplication(A=python.a, B="360")
division = Division(A=multiplication, B=number_slider_2)
previewlw = CustomPreviewLineweights(Geometry=cir, Shader=ColourSwatch(SwatchColor=RGB(0, 0, 0)), Thickness=Slider(3, range=0..10), Absolute=False)
number_slider_4 = Slider(9, range=0..10)
neg = Negative(Value=Slider(2, range=0..10))
loop_start = LoopStart(Repeat=expr("x-1", division), Trigger=Button(), Data="0")  # -> port, Counter, Data
range = Range(Domain=Domain(0, 1), Steps=number_slider_4)
graph = GraphMapper(
    range,
    x0=0,
    x1=1,
    y0=0,
    y1=1,
    container_name="Bezier",
    cpx=[0, 0.4022729993, 0.5717172027, 1],
    cpy=[0, 0.5002397299, 0.6778829694, 1])
addition = Addition(A=loop_start.Data, B=1)
multiplication_2 = Multiplication(A=number_slider_2, B=number_slider_3)
subtraction = Subtraction(A=number_slider_3, B="1")
loop_end = LoopEnd(port=loop_start.port, Exit=False, Data=addition, TimeOutVal=0, pausedState=False, state="Constant output")
multiplication_3 = Multiplication(A=graph, B=Slider(7.6, range=0..10))
multiplication_4 = Multiplication(A=number_slider_2, B=subtraction)
equals = Equality(FirstNumber=loop_end, SecondNumber=division)  # -> Equality, Inequality
neg_2 = Negative(Value=multiplication_3)
R = RecordeData(Data=loop_end, Count=loop_end)
neg_3 = Negative(Value=Slider(4, range=0..10))
offset = OffsetCurve(Curve=cir, Distance=neg, Plane=PlaneXY(0, 0, 0), Corners=1)
number_slider_5 = Slider(25, range=0..100)
range_2 = Range(Domain=Domain(0, 1), Steps=number_slider_4)
multiplication_5 = Multiplication(A=R, B=multiplication_2)
multiplication_6 = Multiplication(A=R, B=multiplication_2)
multiplication_7 = Multiplication(A=R, B=number_slider_2)
multiplication_8 = Multiplication(A=R, B=number_slider_2)
number_slider_6 = Slider(20, range=0..100)
series = Series(Start=Slider(64, range=0..100), Step=neg_3, Count=number_slider_4)
multiplication_9 = Multiplication(A=R, B=multiplication_4)
offset_2 = OffsetCurve(Curve=offset, Distance=neg_2, Plane=PlaneXY(0, 0, 0), Corners=1)
sin = Sine(Value=degrees(multiplication_6))
sin_2 = Sine(Value=degrees(multiplication_8))
cos = Cosine(Value=degrees(multiplication_5))
cos_2 = Cosine(Value=degrees(multiplication_7))
sin_3 = Sine(Value=degrees(multiplication_9))
seam = Seam(Curve=reparameterize(offset_2), Seam=graft(range_2))
multiplication_10 = Multiplication(A=sin, B=number_slider_5)
multiplication_11 = Multiplication(A=cos, B=number_slider_5)
multiplication_12 = Multiplication(A=sin_2, B=number_slider_6)
multiplication_13 = Multiplication(A=cos_2, B=number_slider_6)
neg_4 = Negative(Value=Slider(0.03, range=0..1))
multiplication_14 = Multiplication(A=sin_3, B=Slider(8, range=0..10))
division_2 = Division(A=series, B=2)
addition_2 = Addition(A=multiplication_12, B=multiplication_10)
series_2 = Series(Start=Slider(0.45, range=0..1), Step=neg_4, Count=number_slider_4)
divide = DivideCurve(Curve=seam, Count=graft(series), Kinks=False)  # -> Points, Tangents, Parameters
addition_3 = Addition(A=multiplication_13, B=multiplication_11)
neg_5 = Negative(Value=Slider(0.03, range=0..0.1))
series_3 = Series(Start="1", Step=neg_5, Count=division_2)
neg_6 = Negative(Value=Slider(0.02, range=0..0.1))
pt = ConstructPoint(XCoordinate=addition_2, YCoordinate=addition_3, ZCoordinate=multiplication_14)
multiplication_15 = Multiplication(A=graft(series_2), B=series_3)
series_4 = Series(Start="1", Step=neg_6, Count=division_2)
item = ListItem(List=reverse(pt), Index=0, Wrap=True)  # -> Item, Item1
item_2 = ListItem(List=pt, Index=0, Wrap=True)  # -> Item, Item1
multiplication_16 = Multiplication(A=graft(series_2), B=series_4)
dup = DuplicateData(Data=multiplication_15, Number=2, Order=True)
dist = Distance(PointA=item.Item, PointB=item.Item1)
dist_2 = Distance(PointA=item_2.Item, PointB=item_2.Item1)
dup_2 = DuplicateData(Data=multiplication_16, Number=2, Order=True)
subtraction_2 = Subtraction(A=dist_2, B=dist)
cir_2 = Circle(Plane=divide.Points, Radius=dup_2)
cir_3 = Circle(Plane=divide.Points, Radius=dup)
abs = Absolute(Value=subtraction_2)
division_3 = Division(A=dist, B="10")
crv = Curve(flatten([cir, cir_3]))
crv_2 = Curve(flatten([cir, cir_2]))
smaller = SmallerThan(FirstNumber=abs, SecondNumber=division_3)  # -> SmallerThan, OrEqualTo
boundary = BoundarySurfaces(Edges=crv)
and = GateAnd(A=equals.Equality, B=smaller.SmallerThan)
boundary_2 = BoundarySurfaces(Edges=crv_2)
Z = UnitZ(Factor=Slider(0.3, range=0..1))
intcrv = Interpolate(Vertices=pt, Degree=3, Periodic=and, KnotStyle=1)  # -> Curve, Length, Domain
move = Move(Geometry=boundary_2, Motion=Z)  # -> Geometry, Transform
extr = Extrude(Base=boundary, Direction=Z)
extr_2 = Extrude(Base=move.Geometry, Direction=Z)
preview = CustomPreview(Geometry=extr_2, Material=ColourSwatch(SwatchColor=RGB(255, 255, 255)))
preview_2 = CustomPreview(Geometry=extr, Material=ColourSwatch(SwatchColor=RGB(255, 255, 255)))
