# Grasshopper definition TEST.gh (Grasshopper 1.0.7)
# plug-ins: Kangaroo2 Components

number_slider = Slider(8.1, range=0..10)
number_slider_2 = Slider(15, range=0..20)
mesh = Mesh(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)
bbox = BoundingBox(Content=mesh, Plane=PlaneXY(0, 0, 0))  # -> Box, Box_2
number_slider_3 = Slider(8.1, range=0..10)  # disabled
number_slider_4 = Slider(5, range=0..10)  # disabled
number_slider_5 = Slider(15, range=0..20)  # disabled
number_slider_6 = Slider(100, range=0..100)  # disabled
X = UnitX(Factor=number_slider)
mesh_2 = MeshBrep(
    Brep=bbox.Box,
    Settings={GridMaxCount=0, GridMinCount=16, JaggedSeams=False, MaxEdgeLength=0, MinEdgeLength=0.0001, MinTolerance=0, Refine=True, RefineAngle=0, RelativeTolerance=0.65, SimplePlanes=True, Tolerance=0})
Z = UnitZ(Factor=Slider(100, range=0..100))
msphere = MeshSphere(Base=PlaneXY(0, 0, 0), Radius=number_slider_2, UCount=10, VCount=20)
Y = UnitY(Factor=number_slider)
move = Move(Geometry=msphere, Motion=X)  # -> Geometry, Transform
mbox = MeshBox(
    Base={Plane=PlaneXY(0, 0, 0), X=Domain(-10, 10), Y=Domain(-10, 10), Z=Domain(-10, 10)},
    XCount=number_slider_4,
    YCount=number_slider_4,
    ZCount=number_slider_4)  # disabled
X_2 = UnitX(Factor=number_slider_3)  # disabled
move_2 = Move(Geometry=mesh, Motion=Z)  # -> Geometry, Transform
move_3 = Move(Geometry=mesh_2, Motion=Z)  # -> Geometry, Transform
demesh = DeconstructMesh(Mesh=move_3.Geometry)  # -> Vertices, Faces, Colours, Normals
Z_2 = UnitZ(Factor=number_slider_6)  # disabled
Z_3 = UnitZ(Factor=number_slider_2)
msphere_2 = MeshSphere(Base=PlaneXY(0, 0, 0), Radius=number_slider_5, UCount=10, VCount=20)  # disabled
Y_2 = UnitY(Factor=number_slider_3)  # disabled
move_4 = Move(Geometry=move.Geometry, Motion=Y)  # -> Geometry, Transform
move_5 = Move(Geometry=msphere_2, Motion=X_2)  # -> Geometry, Transform; disabled
move_6 = Move(Geometry=mbox, Motion=Z_2)  # -> Geometry, Transform; disabled
demesh_2 = DeconstructMesh(Mesh=move_6.Geometry)  # -> Vertices, Faces, Colours, Normals; disabled
avr = Average(Input=demesh.Vertices)
Z_4 = UnitZ(Factor=number_slider_5)  # disabled
number_slider_7 = Slider(1000, range=0..10000)  # disabled
move_7 = Move(Geometry=move_4.Geometry, Motion=Z_3)  # -> Geometry, Transform
demesh_3 = DeconstructMesh(Mesh=mesh_2)  # -> Vertices, Faces, Colours, Normals
move_8 = Move(Geometry=move_5.Geometry, Motion=Y_2)  # -> Geometry, Transform; disabled
yz = YZPlane(Origin=avr)
avr_2 = Average(Input=demesh_2.Vertices)  # disabled
rigidbody = RigidBody(Part=move_3.Geometry, Plane=yz, Points=demesh.Vertices, Strength=Slider(1000, range=0..10000))  # -> RigidBody, Planes
item = ListItem(List=demesh_3.Vertices, Index=0, Wrap=True)  # -> Item, Item1, Item2
number_slider_8 = Slider(1000000, range=0..1000000)
move_9 = Move(Geometry=move_8.Geometry, Motion=Z_4)  # -> Geometry, Transform; disabled
xy = XYPlane(Origin=avr_2)  # disabled
rigidbody_2 = RigidBody(Part=move_6.Geometry, Plane=xy, Points=demesh_2.Vertices, Strength=number_slider_7)  # -> RigidBody, Planes; disabled
number_slider_9 = Slider(10000, range=0..10000)  # disabled
number_slider_10 = Slider(1000, range=0..1000)  # disabled
pl_3pt = Plane3Pt(PointA=item.Item, PointB=item.Item1, PointC=item.Item2)
number_slider_11 = Slider(1000000, range=0..1000000)  # disabled
number_slider_12 = Slider(9.8, range=0..10)  # disabled
neg = Negative(Value=Slider(9.8, range=0..10))
floor = Floor(Strength=Slider(10000000, range=0..10000000))
demesh_4 = DeconstructMesh(Mesh=move_7.Geometry)  # -> Vertices, Faces, Colours, Normals
neg_2 = Negative(Value=number_slider_12)  # disabled
Z_5 = UnitZ(Factor=neg)
floor_2 = Floor(Strength=number_slider_11)  # disabled
number_slider_13 = Slider(1000, range=0..10000)  # disabled
demesh_5 = DeconstructMesh(Mesh=move_9.Geometry)  # -> Vertices, Faces, Colours, Normals; disabled
Z_6 = UnitZ(Factor=neg_2)  # disabled
load = Load(Point=[demesh.Vertices, demesh_4.Vertices], ForceVector=Z_5, Weighting=1)
show = Show(G=[move_7.Geometry, move_3.Geometry])
avr_3 = Average(Input=demesh_4.Vertices)
load_2 = Load(Point=[demesh_2.Vertices, demesh_5.Vertices], ForceVector=Z_6, Weighting=1)  # disabled
show_2 = Show(G=[move_9.Geometry, move_6.Geometry])  # disabled
xy_2 = XYPlane(Origin=avr_3)
avr_4 = Average(Input=demesh_5.Vertices)  # disabled
xy_3 = XYPlane(Origin=avr_4)  # disabled
number_slider_14 = Slider(100, range=0..10000)  # disabled
rigidbody_3 = RigidBody(Part=move_7.Geometry, Plane=xy_2, Points=demesh_4.Vertices, Strength=Slider(1000, range=0..10000))  # -> RigidBody, Planes
solidcollide = SolidCollide(MeshA=move_3.Geometry, MeshB=move_7.Geometry, PlaneA=yz, PlaneB=xy_2, Strength=Slider(2000, range=0..10000))
rigidbody_4 = RigidBody(Part=move_9.Geometry, Plane=xy_3, Points=demesh_5.Vertices, Strength=number_slider_13)  # -> RigidBody, Planes; disabled
solidcollide_2 = SolidCollide(MeshA=move_6.Geometry, MeshB=move_9.Geometry, PlaneA=xy, PlaneB=xy_3, Strength=number_slider_14)  # disabled
entwine = Entwine(Branch00=show, Branch01=[load, floor, rigidbody.RigidBody, rigidbody_3.RigidBody, solidcollide], FlattenInputs=True)
entwine_2 = Entwine(
    Branch00=show_2,
    Branch01=[load_2, floor_2, rigidbody_2.RigidBody, rigidbody_4.RigidBody, solidcollide_2],
    FlattenInputs=True)  # disabled
number_slider_15 = Slider(90, range=0..100)  # disabled
toggle = BooleanToggle(False)  # disabled
button = Button()  # disabled
number_slider_16 = Slider(0.995, range=0..1)  # disabled
bouncysolver = BouncySolver(
    GoalObjects=entwine,
    Reset=Button(),
    Threshold=1e-15,
    Tolerance=0.0001,
    Damping=Slider(0.995, range=0..1),
    Iterations=Slider(90, range=0..1000),
    On=Toggle(False))  # -> I, V, O
bouncysolver_2 = BouncySolver(
    GoalObjects=entwine_2,
    Reset=button,
    Threshold=1e-15,
    Tolerance=0.0001,
    Damping=number_slider_16,
    Iterations=number_slider_15,
    On=toggle)  # -> I, V, O; disabled
bang = ExplodeTree(Data=bouncysolver.O)  # -> Branch0, Branch1
bang_2 = ExplodeTree(Data=bouncysolver_2.O)  # -> Branch0, Branch1; disabled
item_2 = ListItem(List=bang.Branch0, Index=0, Wrap=True)  # -> Item, Item1
swatch = ColourSwatch(SwatchColor=RGB(255, 255, 255))  # disabled
mesh_3 = Mesh(bang_2.Branch0)  # disabled
demesh_6 = DeconstructMesh(Mesh=item_2.Item1)  # -> Vertices, Faces, Colours, Normals
preview = CustomPreview(Geometry=mesh_3, Material=swatch)  # disabled
item_3 = ListItem(List=demesh_6.Vertices, Index=0, Wrap=True)  # -> Item, Item1, Item2
pl_3pt_2 = Plane3Pt(PointA=item_3.Item, PointB=item_3.Item1, PointC=item_3.Item2)
orient = Orient(Geometry=mesh, Source=pl_3pt, Target=pl_3pt_2)  # -> Geometry, Transform
preview_2 = CustomPreview(Geometry=[orient.Geometry, item_2.Item], Material=ColourSwatch(SwatchColor=RGB(255, 255, 255)))
