# Grasshopper definition test2.gh (Grasshopper 1.0.7)
# plug-ins: Kangaroo2 Components, Bifocals

pt = ConstructPoint(XCoordinate=Slider(7, range=0..100), YCoordinate=0, ZCoordinate=0)
pt_2 = ConstructPoint(XCoordinate=Slider(57, range=0..100), YCoordinate=0, ZCoordinate=0)
ln = Line(StartPoint=pt, EndPoint=pt_2)
number_slider = Slider(0.5, range=0..1)
trigger = Trigger(Interval=1000, TimerInterval=1000, Target=time)  # disabled
crv = Curve(ln)
cir = Circle(Plane=PlaneXY(0, 0, 0), Radius=Slider(3, range=0..10))
divlength = DivideLength(Curve=crv, Length=number_slider)  # -> Points, Tangents, Parameters
boundary = BoundarySurfaces(Edges=cir)
time = Time("now")
shatter = Shatter(Curve=crv, Parameters=divlength.Parameters)
ddate = DeconstructDate(Date=time)  # -> Year, Month, Day, Hour, Minute, Second
Z = UnitZ(Factor=Slider(23, range=0..100))
join = JoinCurves(Curves=shatter, Preserve=False)
extr = Extrude(Base=boundary, Direction=Z)
move = Move(Geometry=cir, Motion=Z)  # -> Geometry, Transform
multiplication = Multiplication(A=ddate.Minute, B=60)
neg = Negative(Value=Slider(0.1, range=0..10))
length_line = LengthLine(Line=shatter, Length=number_slider, Strength=Slider(50, range=0..100))
ma = MassAddition(Input=[multiplication, ddate.Second])  # -> Result, PartialResults
mesh = MeshBrep(
    Brep=extr,
    Settings={GridMaxCount=0, GridMinCount=16, JaggedSeams=False, MaxEdgeLength=0, MinEdgeLength=0.0001, MinTolerance=0, Refine=True, RefineAngle=0, RelativeTolerance=0.65, SimplePlanes=True, Tolerance=0})
Z_2 = UnitZ(Factor=neg)
preview = CustomPreview(Geometry=extr, Material=ColourSwatch(SwatchColor=RGB(255, 255, 255)))
show = Show(G=join)
item = ListItem(List=divlength.Points, Index=0, Wrap=True)
smooth = SmoothNumbers(Numbers=ma.Result, SmoothDelay=2000)
load = Load(Point=divlength.Points, ForceVector=Z_2, Weighting=1)
spc = SolidPointCollide(Points=divlength.Points, Solid=mesh, Interior=False, Unidirectional=True, Strength=Slider(200, range=0..1000))
mod = Modulus(A=smooth, B="1")
offset = OffsetCurve(Curve=move.Geometry, Distance=Slider(0.5, range=0..1), Plane=PlaneXY(0, 0, 0), Corners=1)
eval = EvaluateCurve(Curve=reparameterize(offset), Parameter=mod)  # -> Point, Tangent, Angle
anchor = Anchor(Point=item, Target=eval.Point, Strength=Slider(500, range=0..1000))
floor = Floor(Strength=Slider(500, range=0..1000))
entwine = Entwine(Branch00=show, Branch01=[floor, length_line, anchor, load, spc], FlattenInputs=True)
toggle = BooleanToggle(False)
button = Button()
solver = Solver(GoalObjects=entwine, Reset=button, Threshold=1e-15, Tolerance=0.01, On=toggle)  # -> I, V, O; disabled
bouncysolver = BouncySolver(
    GoalObjects=entwine,
    Reset=button,
    Threshold=1e-15,
    Tolerance=0.01,
    Damping=0.99,
    Iterations=Slider(50, range=0..100),
    On=toggle)  # -> I, V, O
bang = ExplodeTree(Data=bouncysolver.O)  # -> Branch0, Branch1
crv_2 = Curve(bang.Branch0)
pipe = Pipe(Curve=crv_2, Radius=Slider(0.1, range=0..1), Caps="1")
preview_2 = CustomPreview(Geometry=pipe, Material=ColourSwatch(SwatchColor=RGB(0, 0, 0)))
