# Grasshopper definition 鼠标1222.gh (Grasshopper 1.0.7)
# plug-ins: Pufferfish, LunchBox

number_slider = Slider(12, range=0..100)
number_slider_2 = Slider(18, range=0..100)
dom = ConstructDomain(DomainStart=expr("-x/2", number_slider_2), DomainEnd=expr("x/2", number_slider_2))
dom_2 = ConstructDomain(DomainStart=expr("-x/2", number_slider), DomainEnd=expr("x/2", number_slider))
rectangle = Rectangle(Plane=PlaneXY(0, 0, 0), XSize=dom, YSize=dom_2, Radius=0)  # -> Rectangle, Length
explode = Explode(Curve=rectangle.Rectangle, Recursive=True)  # -> Segments, Vertices
item = ListItem(List=explode.Segments, Index=0, Wrap=True)  # -> Item, Item1
midpt = CurveMiddle(Curve=item.Item)
area = Area(Geometry=rectangle.Rectangle)  # -> Area, Centroid
midpt_2 = CurveMiddle(Curve=item.Item1)
vec2pt = Vector2Pt(PointA=midpt_2, PointB=area.Centroid, Unitize=False)  # -> Vector, Length
vec2pt_2 = Vector2Pt(PointA=midpt, PointB=area.Centroid, Unitize=False)  # -> Vector, Length
multiplication = Multiplication(A=vec2pt_2.Vector, B=Slider(0.2, range=0..1))
multiplication_2 = Multiplication(A=vec2pt.Vector, B=Slider(0.3, range=0..1))
end = EndPoints(Curve=item.Item)  # -> Start, End
end_2 = EndPoints(Curve=item.Item1)  # -> Start, End
move = Move(Geometry=midpt_2, Motion=expr("-x", multiplication_2))  # -> Geometry, Transform
move_2 = Move(Geometry=midpt, Motion=multiplication)  # -> Geometry, Transform
number_slider_3 = Slider(0.5, range=0..1)
number_slider_4 = Slider(0.5, range=0..1)
weave = Weave(Pattern=[0, 1, 2], Stream0=end.Start, Stream1=move_2.Geometry, Stream2=end.End, NullGaps=False)
number_slider_5 = Slider(0.23, range=0..1)
weave_2 = Weave(Pattern=[0, 1, 2], Stream0=end_2.Start, Stream1=move.Geometry, Stream2=end_2.End, NullGaps=False)
intcrv = Interpolate(Vertices=weave, Degree=3, Periodic=False, KnotStyle=1)  # -> Curve, Length, Domain
intcrv_2 = Interpolate(Vertices=weave_2, Degree=3, Periodic=False, KnotStyle=1)  # -> Curve, Length, Domain
number_slider_6 = Slider(0.2, range=0..10)
crv = Curve(item.Item)
线变短 = 线变短(C=intcrv.Curve, A=number_slider_5)
线变短_2 = 线变短(C=intcrv_2.Curve, A=number_slider_5)
move_3 = Move(Geometry=crv, Motion=vec2pt_2.Vector)  # -> Geometry, Transform
Z = UnitZ(Factor=number_slider_6)
shatter = Shatter(Curve=reparameterize(线变短_2), Parameters="0.5")
move_4 = Move(Geometry=move_3.Geometry, Motion=Z)  # -> Geometry, Transform
move_5 = Move(Geometry=线变短, Motion=Z)  # -> Geometry, Transform
item_2 = ListItem(List=shatter, Index=0, Wrap=True)
blendc = BlendCurve(CurveA=线变短, CurveB=item_2, BulgeA=number_slider_4, BulgeB=number_slider_4, Continuity=Slider(2, range=0..2))
end_3 = EndPoints(Curve=move_4.Geometry)  # -> Start, End
Z_2 = UnitZ(Factor=Slider(2, range=0..10))
ext = ExtendCurve(Curve=move_5.Geometry, Type=0, Start=Slider(5, range=-3..8), End="0")
Z_3 = UnitZ(Factor=number_slider_6)
move_6 = Move(Geometry=end_3.Start, Motion=Z_2)  # -> Geometry, Transform
move_7 = Move(Geometry=item_2, Motion=Z_3)  # -> Geometry, Transform
余弦曲线 = 余弦曲线(crv=ext, 高度_2=Slider(3, range=0..10))  # -> G, C
dom_3 = ConstructDomain(DomainStart=0, DomainEnd=Slider(0.85, range=0..1))
subcrv = SubCurve(BaseCurve=reparameterize(余弦曲线.G), Domain=dom_3)

flip = FlipCurve(Curve=subcrv)  # -> Curve, Flag
Z_4 = UnitZ(Factor=Slider(0.45, range=0..1))
dom_4 = ConstructDomain(DomainStart=Slider(0.05, range=0..1), DomainEnd=1)
crv_2 = Curve(flip.Curve)
end_4 = EndPoints(Curve=crv_2)  # -> Start, End
subcrv_2 = SubCurve(BaseCurve=reparameterize(crv_2), Domain=dom_4)
X = UnitX(Factor=Slider(3.7, range=0..10))
pt = Point(end_4.Start)
move_8 = Move(Geometry=pt, Motion=Z_4)  # -> Geometry, Transform
move_9 = Move(Geometry=move_8.Geometry, Motion=expr("-x", X))  # -> Geometry, Transform
flip_2 = FlipCurve(Curve=subcrv_2)  # -> Curve, Flag
pt_2 = Point(move_6.Geometry)
pdecon = Deconstruct(Point=pt_2)  # -> XComponent, YComponent, ZComponent
pdecon_2 = Deconstruct(Point=move_9.Geometry)  # -> XComponent, YComponent, ZComponent
pdecon_3 = Deconstruct(Point=pt)  # -> XComponent, YComponent, ZComponent
pt_3 = ConstructPoint(XCoordinate=pdecon.XComponent, YCoordinate=pdecon.YComponent, ZCoordinate=pdecon_3.ZComponent)
pt_4 = ConstructPoint(XCoordinate=pdecon.XComponent, YCoordinate=pdecon_2.YComponent, ZCoordinate=pdecon_3.ZComponent)
pt_5 = ConstructPoint(XCoordinate=pdecon_3.XComponent, YCoordinate=pdecon_3.YComponent, ZCoordinate=pdecon_3.ZComponent)
weave_3 = Weave(Pattern=[0, 1, 2], Stream0=pt_5, Stream1=pt_4, Stream2=pt_3, NullGaps=False)
nurbs = NurbsCurve(Vertices=weave_3, Degree=2, Periodic=False)  # -> Curve, Length, Domain
crv_3 = Curve(nurbs.Curve)
dom_5 = ConstructDomain(DomainStart=Slider(0.25, range=0..1), DomainEnd=1)
subcrv_3 = SubCurve(BaseCurve=reparameterize(crv_3), Domain=dom_5)
number_slider_7 = Slider(0.5, range=0..1)
blendc_2 = BlendCurve(CurveA=flip_2.Curve, CurveB=subcrv_3, BulgeA=number_slider_7, BulgeB=number_slider_7, Continuity=Slider(2, range=0..2))

blendc_3 = BlendCurve(CurveA=crv_2, CurveB=move_7.Geometry, BulgeA=number_slider_3, BulgeB=number_slider_3, Continuity=Slider(2, range=0..2))
subcrv_4 = SubCurve(BaseCurve=reparameterize(crv_3), Domain=dom_5)
project = Project(Geometry=subcrv_3, Plane=PlaneXY(0, 0, 0))  # -> Geometry, Transform
end_5 = EndPoints(Curve=subcrv_4)  # -> Start, End
X_2 = UnitX(Factor=Slider(0.84, range=0..1))
number_slider_8 = Slider(0.5, range=0..1)
move_10 = Move(Geometry=project.Geometry, Motion=X_2)  # -> Geometry, Transform
scale_nu = ScaleNU(Geometry=subcrv_4, Plane=end_5.Start, ScaleX=Slider(1.4, range=1..2), ScaleY=1, ScaleZ=1)  # -> Geometry, Transform
flip_3 = FlipCurve(Curve=move_10.Geometry)  # -> Curve, Flag
number_slider_9 = Slider(6, range=0..10)
number_slider_10 = Slider(0.98, range=0..1)
blendc_4 = BlendCurve(CurveA=flip_3.Curve, CurveB=线变短, BulgeA=number_slider_8, BulgeB=number_slider_8, Continuity=Slider(2, range=0..2))
join = JoinCurves(Curves=flatten([blendc_3, move_7.Geometry, flip_2.Curve, subcrv_3, blendc_2]), Preserve=False)
join_2 = JoinCurves(Curves=flatten([线变短, blendc, item_2, flip_3.Curve, blendc_4]), Preserve=False)
join_3 = JoinCurves(Curves=flatten([blendc_3, move_7.Geometry, flip_2.Curve, blendc_2, scale_nu.Geometry]), Preserve=False)
range = Range(Domain=Domain(0, 1), Steps=number_slider_9)
scale_nu_2 = ScaleNU(Geometry=join, Plane=PlaneXY(0, 0, 0), ScaleX=number_slider_10, ScaleY=number_slider_10, ScaleZ=1)  # -> Geometry, Transform
graph = GraphMapper(
    range,
    x0=0,
    x1=1,
    y0=0,
    y1=1,
    container_name="Bezier",
    cpx=[0, 0.2623397112, 0.7306102514, 1],
    cpy=[0, 0.3258852959, 0.3510609269, 0])
number_slider_11 = Slider(4, range=0..10)
end_6 = EndPoints(Curve=join_2)  # -> Start, End
flip_4 = FlipCurve(Curve=join_2)  # -> Curve, Flag
映射 = 映射(V=graph, A=0, B=number_slider_11)
end_7 = EndPoints(Curve=join)  # -> Start, End
end_8 = EndPoints(Curve=join_3)  # -> Start, End
ln = Line(StartPoint=end_6.Start, EndPoint=end_6.End)
ln_2 = Line(StartPoint=end_7.Start, EndPoint=end_7.End)
divide = DivideCurve(Curve=ln_2, Count=number_slider_9, Kinks=False)  # -> Points, Tangents, Parameters
Z_5 = UnitZ(Factor=映射)
move_11 = Move(Geometry=divide.Points, Motion=Z_5)  # -> Geometry, Transform
rebcrv = RebuildCurve(Curve=[join, scale_nu_2.Geometry, flip_4.Curve], Count=Slider(182, range=0..256), Degree="3", EndTangents=False)
join_4 = JoinCurves(Curves=flatten([join_2, ln]), Preserve=False)
division = Division(A=vec2pt_2.Vector, B=Slider(8, range=0..10))
nurbs_2 = NurbsCurve(Vertices=move_11.Geometry, Degree=3, Periodic=False)  # -> Curve, Length, Domain
cull_i = CullIndex(List=move_11.Geometry, Indices="-1", Wrap=True)  # -> reverse(List)
number_slider_12 = Slider(0.14, range=0..1)
dom_6 = ConstructDomain(DomainStart=0, DomainEnd=Slider(0.89, range=0..1))
merge = Merge(Data1=end_8.End, Data2=cull_i)  # -> flatten(Result)
subcrv_5 = SubCurve(BaseCurve=reparameterize(nurbs_2.Curve), Domain=dom_6)
move_12 = Move(Geometry=subcrv_5, Motion=expr("-x", division))  # -> Geometry, Transform
join_5 = JoinCurves(Curves=join_3, Preserve=False)
nurbs_3 = NurbsCurve(Vertices=merge, Degree=3, Periodic=False)  # -> Curve, Length, Domain
dom_7 = ConstructDomain(DomainStart=number_slider_12, DomainEnd=expr("1-x", number_slider_12))
subcrv_6 = SubCurve(BaseCurve=reparameterize(move_12.Geometry), Domain=dom_7)
eval = EvaluateCurve(Curve=reparameterize(nurbs_2.Curve), Parameter=[Slider(0.73, range=0..1), Slider(0.65, range=0..1)])  # -> Point, Tangent, Angle
number_slider_13 = Slider(0.1, range=0..1)
dom_8 = ConstructDomain(DomainStart=Slider(0.28, range=0..1), DomainEnd=Slider(0.72, range=0..1))
eval_2 = EvaluateCurve(Curve=reparameterize(nurbs_2.Curve), Parameter=Slider(0.9, range=0..1))  # -> Point, Tangent, Angle
number_slider_14 = Slider(1, range=0..10)
subcrv_7 = SubCurve(BaseCurve=reparameterize(余弦曲线.G), Domain=dom_8)
xz = XZPlane(Origin=eval_2.Point)
multiplication_3 = Multiplication(A=number_slider_11, B=Slider(0.4, range=0..1))
dom_9 = ConstructDomain(DomainStart=number_slider_13, DomainEnd=expr("1-x", number_slider_13))
boundary = BoundarySurfaces(Edges=join_4)
project_2 = Project(Geometry=subcrv_7, Plane=PlaneXY(0, 0, 0))  # -> Geometry, Transform
dom_10 = ConstructDomain(DomainStart=expr("-x/2", number_slider_14), DomainEnd=expr("x/2", number_slider_14))
xz_2 = XZPlane(Origin=Point(0, 0, 0))
cir = Circle(Plane=xz, Radius=multiplication_3)
multiplication_4 = Multiplication(A=multiplication_3, B=Slider(0.6, range=0..1))
multiplication_5 = Multiplication(A=multiplication_3, B=Slider(0.2, range=0..1))
subcrv_8 = SubCurve(BaseCurve=reparameterize(project_2.Geometry), Domain=dom_9)
brep = Brep(boundary)
brec = BoundingRectangle(Geometry=cir, Plane=xz_2, Axis=0, Slide=0, Union=True)
range_2 = Range(Domain=Domain(0, 1), Steps=Slider(4, range=0..10))
xz_3 = XZPlane(Origin=Point(0, 0, 0))
Z_6 = UnitZ(Factor=multiplication_4)
move_13 = Move(Geometry=cir, Motion=expr("-x", Z_6))  # -> Geometry, Transform
debrep = DeconstructBrep(Brep=brec)  # -> Faces, Edges, Vertices
tweencrv = TweenCurve(CurveA=subcrv_7, CurveB=subcrv_8, Factor=range_2, BlendType=0)
mirror = Mirror(Geometry=brep, Plane=xz_3)  # -> Geometry, Transform
Y = UnitY(Factor=multiplication_5)
item_3 = ListItem(List=debrep.Edges, Index=0, Wrap=True)  # -> Item, Item1
boundary_2 = BoundarySurfaces(Edges=brec)
brep_2 = Brep([mirror.Geometry, boundary])
item_4 = ListItem(List=reverse(tweencrv), Index="1", Wrap=True)
neg = Negative(Value=Y)
item_5 = ListItem(List=tweencrv, Index="1", Wrap=True)
midpt_3 = CurveMiddle(Curve=item_3.Item1)
dom_11 = ConstructDomain(DomainStart=Slider(0, range=0..1), DomainEnd=Slider(0.48, range=0..1))
dom_12 = ConstructDomain(DomainStart=Slider(0.52, range=0..1), DomainEnd=Slider(1, range=0..1))
extr = Extrude(Base=boundary_2, Direction=neg)
brec_2 = BoundingRectangle(Geometry=brep_2, Plane=PlaneXY(0, 0, 0), Axis=0, Slide=0, Union=True)
runion = RegionUnion(Curves=brep_2)
move_14 = Move(Geometry=move_13.Geometry, Motion=neg)  # -> Geometry, Transform
area_2 = Area(Geometry=runion)  # -> Area, Centroid
patch = Patch(Curves=flatten([join_5, subcrv_6, nurbs_3.Curve]), Spans=Slider(30, range=0..100), Flexibility=1, Trim=True)
subcrv_9 = SubCurve(BaseCurve=reparameterize([item_5, item_4]), Domain=dom_11)
subcrv_10 = SubCurve(BaseCurve=reparameterize([item_5, item_4]), Domain=dom_12)
area_3 = Area(Geometry=move_14.Geometry)  # -> Area, Centroid
number_slider_15 = Slider(12, range=0..100)
offset = OffsetCurve(Curve=brec_2, Distance=expr("-x", Slider(1.5, range=0..10)), Plane=PlaneXY(0, 0, 0), Corners=1)
scale_nu_3 = ScaleNU(Geometry=extr, Plane=midpt_3, ScaleX="3", ScaleY=Slider(1.5, range=0..10), ScaleZ="3")  # -> Geometry, Transform
series = Series(Start=Slider(11, range=0..100), Step=expr("-x", Slider(5, range=0..10)), Count="2")  # -> graft(Series)
scale = Scale(Geometry=runion, Center=area_2.Centroid, Factor=Slider(0.88, range=0..1))  # -> Geometry, Transform
loft_opt = LoftOptions(Closed=False, Adjust=False, Rebuild=0, Refit=0, Type="1")
loft = Loft(Curves=subcrv_9, Options={Adjust=False, Closed=False, LoftEnds=0, LoftSimp=0, LoftType=0, Rebuild=10, Refit=0.01})
loft_2 = Loft(Curves=subcrv_10, Options={Adjust=False, Closed=False, LoftEnds=0, LoftSimp=0, LoftType=0, Rebuild=10, Refit=0.01})
scale_2 = Scale(Geometry=move_14.Geometry, Center=area_3.Centroid, Factor=Slider(0.85, range=0..1))  # -> Geometry, Transform
split = SplitBrep(Brep=patch, Cutter=scale_nu_3.Geometry)
Z_7 = UnitZ(Factor=Slider(0.05, range=0..0.1))
# 底侧
loft_3 = Loft(Curves=rebcrv, Options=loft_opt)
weave_4 = Weave(Pattern=[0, 1], Stream0=move_14.Geometry, Stream1=scale_2.Geometry, NullGaps=False)
dom_13 = ConstructDomain(DomainStart=Slider(0.1, range=0..1), DomainEnd=Slider(0.7, range=0..1))
neg_2 = Negative(Value=Z_7)
item_6 = ListItem(List=split, Index=0, Wrap=True)  # -> Item, Item1
srf = Surface(item_6.Item)
move_15 = Move(Geometry=scale.Geometry, Motion=neg_2)  # -> Geometry, Transform
geo = Geometry(flatten(weave_4))
flip_5 = Flip(Surface=loft_3)  # -> Surface, Result
Z_8 = UnitZ(Factor=Slider(0.1, range=0..1))
random = Random(Range=dom_13, Number=number_slider_15, Seed=2)
edges = BrepEdges(Brep=srf)  # -> Naked, Interior, NonManifold
boundary_3 = BoundarySurfaces(Edges=scale_2.Geometry)
xz_4 = XZPlane(Origin=Point(0, 0, 0))
rebcrv_2 = RebuildCurve(Curve=[runion, move_15.Geometry], EndTangents=False)
pop2d = Populate2D(Region=offset, Count=number_slider_15, Seed=Slider(3, range=0..10))
move_16 = Move(Geometry=item_6.Item1, Motion=Z_8)  # -> Geometry, Transform
srf_cp = SurfaceClosestPoint(Point=eval.Point, Surface=move_16.Geometry)  # -> Point, UVPoint, Distance
evalsrf = EvaluateSurface(Surface=move_16.Geometry, Point=srf_cp.UVPoint)  # -> Point, Normal, UDirection, VDirection, Frame
rectangle_2 = Rectangle(Plane=evalsrf.Frame, XSize=dom_10, YSize=dom_10, Radius=0)  # -> graft(Rectangle), Length
xz_5 = XZPlane(Origin=graft(srf_cp.Point))
brec_3 = BoundingRectangle(Geometry=rectangle_2.Rectangle, Plane=PlaneXY(0, 0, 0), Axis=0, Slide=0, Union=True)
area_4 = Area(Geometry=brec_3)  # -> Area, Centroid
project_3 = Project(Geometry=rectangle_2.Rectangle, Plane=area_4.Centroid)  # -> Geometry, Transform
rotate = Rotate(Geometry=project_3.Geometry, Angle=degrees(series), Plane=xz_5)  # -> Geometry, Transform
fillet = Fillet(Curve=rotate.Geometry, Radius=Slider(0.1, range=0..0.1))
boundary_4 = BoundarySurfaces(Edges=fillet)
Y_2 = UnitY(Factor=1)
item_7 = ListItem(List=edges.Naked, Index=0, Wrap=True)  # -> Item, Item1
mirror_2 = Mirror(Geometry=geo, Plane=xz_4)  # -> Geometry, Transform
Z_9 = UnitZ(Factor=Slider(0.3, range=0..1))
geo_2 = Geometry(flatten(boundary_3))
loft_4 = Loft(Curves=rebcrv_2, Options={Adjust=False, Closed=False, LoftEnds=0, LoftSimp=0, LoftType=0, Rebuild=10, Refit=0.01})
extr_2 = Extrude(Base=boundary_4, Direction=Z_9)
xz_6 = XZPlane(Origin=Point(0, 0, 0))
project_4 = Project(Curve=[loft, loft_2], Brep=loft_3, Direction=Y_2)  # -> flatten(Curve)
brep_3 = Brep(move_16.Geometry)
edges_2 = BrepEdges(Brep=loft_3)  # -> Naked, Interior, NonManifold
xz_7 = XZPlane(Origin=Point(0, 0, 0))
xz_8 = XZPlane(Origin=Point(0, 0, 0))
crv_4 = Curve(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)
item_8 = ListItem(List=mirror_2.Geometry, Index=0, Wrap=True)  # -> Item, Item1
boundary_5 = BoundarySurfaces(Edges=flatten(move_15.Geometry))
offsrf = OffsetSurface(Surface=flatten(flip_5.Surface), Distance=Slider(0.05, range=0..0.1), BothSides=False, CreateSolid=True)
mirror_3 = Mirror(Geometry=brep_3, Plane=xz_6)  # -> Geometry, Transform
number_slider_16 = Slider(0.2, range=0..1)
orient = Orient(Geometry=crv_4, Source=PlaneXY(0, 0, 0), Target=pop2d)  # -> Geometry, Transform
mirror_4 = Mirror(Geometry=item_7.Item1, Plane=xz_8)  # -> Geometry, Transform
brep_4 = Brep([mirror_3.Geometry, brep_3])
brep_5 = Brep(brep_4)
item_9 = ListItem(List=edges_2.Naked, Index=0, Wrap=True)  # -> Item, Item1, Item2
srfsplit = SurfaceSplit(Surface=graft(loft_3), Curves=project_4)
mirror_5 = Mirror(Geometry=geo_2, Plane=xz_7)  # -> Geometry, Transform
weave_5 = Weave(
    Pattern=[0, 1, 2, 3],
    Stream0=scale_2.Geometry,
    Stream1=move_14.Geometry,
    Stream2=item_8.Item,
    Stream3=item_8.Item1,
    NullGaps=False)
scale_3 = Scale(Geometry=orient.Geometry, Center=pop2d, Factor=random)  # -> Geometry, Transform
brep_6 = Brep(offsrf)
loft_5 = Loft(
    Curves=[item_7.Item1, mirror_4.Geometry],
    Options={Adjust=False, Closed=False, LoftEnds=0, LoftSimp=0, LoftType=0, Rebuild=10, Refit=0.01})
loft_6 = Loft(Curves=weave_5, Options={Adjust=False, Closed=False, LoftEnds=0, LoftSimp=0, LoftType=1, Rebuild=10, Refit=0.01})
quads = QuadPanels(Surface=loft_6, UDivisions=Slider(6, range=0..100), VDivisions=Slider(96, range=0..100))
xz_9 = XZPlane(Origin=Point(0, 0, 0))
join_6 = BrepJoin(Breps=brep_4)  # -> Breps, Closed
area_5 = Area(Geometry=srfsplit)  # -> Area, Centroid
dispatch = Dispatch(List=quads, DispatchPattern=[True, False])  # -> ListA, ListB
geo_3 = Geometry(flatten([boundary_3, mirror_5.Geometry]))
crv_5 = Curve(loft_5)
project_5 = Project(Curve=scale_3.Geometry, Brep=graft(brep_5), Direction=Vector(0, 0, 1))
eval_3 = EvaluateLength(Curve=item_9.Item2, Length=number_slider_16, Normalized=True)  # -> Point, Tangent, Parameter
mirror_6 = Mirror(Geometry=brep_6, Plane=xz_9)  # -> Geometry, Transform
sort = SortList(Keys=area_5.Centroid, ValuesA=srfsplit)  # -> Keys, reverse(ValuesA)
project_6 = Project(Geometry=crv_5, Plane=PlaneXY(0, 0, 0))  # -> Geometry, Transform
number_slider_17 = Slider(0.25, range=0..1)
join_7 = BrepJoin(Breps=dispatch.ListA)  # -> Breps, Closed
join_8 = JoinCurves(Curves=flatten(project_5), Preserve=False)
srfsplit_2 = SurfaceSplit(Surface=brep_5, Curves=join_8)  # -> flatten(Fragments)
area_6 = Area(Geometry=srfsplit_2)  # -> Area, Centroid
mesh = MeshBrep(
    Brep=dispatch.ListB,
    Settings={GridMaxCount=0, GridMinCount=16, JaggedSeams=False, MaxEdgeLength=0, MinEdgeLength=0.0001, MinTolerance=0, Refine=True, RefineAngle=0, RelativeTolerance=0.65, SimplePlanes=True, Tolerance=0})
crv_6 = Curve(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)
mesh_2 = MeshBrep(
    Brep=geo_3,
    Settings={GridMaxCount=0, GridMinCount=16, JaggedSeams=False, MaxEdgeLength=0, MinEdgeLength=0.0001, MinTolerance=0, Refine=True, RefineAngle=0, RelativeTolerance=0.65, SimplePlanes=True, Tolerance=0})
item_10 = ListItem(List=sort.ValuesA, Index=0, Wrap=True)  # -> Item, Item1
Z_10 = UnitZ(Factor=Slider(0.1, range=0..0.1))
mesh_3 = MeshBrep(
    Brep=join_7.Breps,
    Settings={GridMaxCount=0, GridMinCount=16, JaggedSeams=False, MaxEdgeLength=0, MinEdgeLength=0.0001, MinTolerance=0, Refine=True, RefineAngle=0, RelativeTolerance=0.65, SimplePlanes=True, Tolerance=0})
sort_2 = SortList(Keys=area_6.Centroid, ValuesA=srfsplit_2)  # -> Keys, ValuesA
scale_nu_4 = ScaleNU(
    Geometry=project_6.Geometry,
    Plane=PlaneXY(0, 0, 0),
    ScaleX=Slider(0.9, range=0..1),
    ScaleY=Slider(1.5, range=0..10),
    ScaleZ=1)  # -> Geometry, Transform
extr_3 = Extrude(Base=join, Direction=Z_8)
end_9 = EndPoints(Curve=crv_6)  # -> Start, End
mjoin = MeshJoin(Meshes=flatten(mesh_3))
loft_7 = Loft(
    Curves=[loft_5, scale_nu_4.Geometry],
    Options={Adjust=False, Closed=False, LoftEnds=0, LoftSimp=0, LoftType=0, Rebuild=10, Refit=0.01})
extr_4 = Extrude(Base=join_6.Breps, Direction=Z_10)
boundary_6 = BoundarySurfaces(Edges=scale_nu_4.Geometry)
offset_2 = OffsetSurface(Surface=item_10.Item, Distance=expr("-x", number_slider_17), Retrim=True)
series_2 = Series(Start=0, Step=1, Count="2")
brep_7 = Brep(extr_3)
offset_3 = OffsetSurface(Surface=item_10.Item1, Distance=expr("-x", number_slider_17), Retrim=True)
xz_10 = XZPlane(Origin=Point(0, 0, 0))
move2pt = Move2Pt(Geometry=crv_6, PointA=end_9.Start, PointB=eval_3.Point)  # -> Moved, Vector, Transform
number_slider_18 = Slider(0.9, range=0..1)
offmsh = OffsetMesh(Mesh=mjoin, Distance=Slider(0.05, range=0..0.1), BothSides=True, CreateSolid=True)  # -> flatten(Offset)
join_9 = BrepJoin(Breps=[loft_5, loft_7, boundary_6])  # -> Breps, Closed
area_7 = Area(Geometry=offset_2)  # -> Area, Centroid
mirror_7 = Mirror(Geometry=brep_7, Plane=xz_10)  # -> Geometry, Transform
cull_i_2 = CullIndex(List=sort_2.ValuesA, Indices=series_2, Wrap=True)
area_8 = Area(Geometry=offset_3)  # -> Area, Centroid
pipe = Pipe(Curve=move2pt.Moved, Radius=number_slider_16, Caps=0)
mjoin_2 = MeshJoin(Meshes=flatten([mesh, offmsh, mesh_2]))
scale_4 = Scale(Geometry=offset_2, Center=area_7.Centroid, Factor=number_slider_18)  # -> Geometry, Transform
scale_5 = Scale(Geometry=offset_3, Center=area_8.Centroid, Factor=number_slider_18)  # -> Geometry, Transform
move_17 = Move(Geometry=cull_i_2, Motion=Z_10)  # -> Geometry, Transform
cap = CapHoles(Brep=pipe)
bbox = BoundingBox(Content=mjoin_2, Plane=PlaneXY(0, 0, 0))  # -> Box, Box_2
sdiff = SolidDifference(BrepsA=join_9.Breps, BrepsB=bbox.Box)
weave_6 = Weave(Pattern=[0, 1, 2], Stream0=item_10.Item1, Stream1=offset_3, Stream2=scale_5.Geometry, NullGaps=False)
weave_7 = Weave(Pattern=[0, 1, 2], Stream0=item_10.Item, Stream1=offset_2, Stream2=scale_4.Geometry, NullGaps=False)
offsrf_2 = OffsetSurface(Surface=move_17.Geometry, Distance=Slider(0.01, range=0..0.01), BothSides=True, CreateSolid=True)
swatch = ColourSwatch(SwatchColor=RGB(51, 51, 51))
rgb = ColourRGB(Alpha=255, Red=Slider(39, range=0..100), Green=Slider(42, range=0..100), Blue=Slider(51, range=0..100))
crv_7 = Curve(weave_7)
crv_8 = Curve(weave_6)
# 滚轮
preview = CustomPreview(Geometry=mjoin_2, Material=swatch)
# 分缝
preview_2 = CustomPreview(Geometry=[extr_3, mirror_7.Geometry], Material=ColourSwatch(SwatchColor=RGB(242, 237, 145)))
# 上盖
preview_3 = CustomPreview(Geometry=[extr_4, sdiff], Material=ColourSwatch(SwatchColor=RGB(39, 42, 51)))
# 侧盖
preview_4 = CustomPreview(Geometry=[brep_6, mirror_6.Geometry], Material=swatch)
# 线
preview_5 = CustomPreview(Geometry=cap, Material=swatch)
patch_2 = Patch(Curves=graft([scale_4.Geometry, scale_5.Geometry]), Spans=Slider(20, range=0..100), Flexibility=1, Trim=True)
loft_8 = Loft(Curves=crv_7, Options={Adjust=False, Closed=False, LoftEnds=0, LoftSimp=0, LoftType=1, Rebuild=10, Refit=0.01})
# 底盖
preview_6 = CustomPreview(Geometry=boundary_5, Material=ColourSwatch(SwatchColor=RGB(36, 36, 36)))
loft_9 = Loft(Curves=crv_8, Options={Adjust=False, Closed=False, LoftEnds=0, LoftSimp=0, LoftType=1, Rebuild=10, Refit=0.01})
# 底环
preview_7 = CustomPreview(Geometry=loft_4, Material=ColourSwatch(SwatchColor=RGB(31, 31, 31)))
# 星星
preview_8 = CustomPreview(Geometry=offsrf_2, Material=ColourSwatch(SwatchColor=RGB(248, 255, 171)))
brep_8 = Brep(flatten([loft_8, patch_2, loft_9]))
join_10 = BrepJoin(Breps=brep_8)  # -> Breps, Closed
# 侧键
swatch_2 = ColourSwatch(SwatchColor=RGB(255, 255, 255))
# dpi键
preview_9 = CustomPreview(Geometry=extr_2, Material=swatch_2)
preview_10 = CustomPreview(Geometry=join_10.Breps, Material=swatch_2)

# ==== cluster 线变短
C = ClusterInput()
A = ClusterInput()
dom = ConstructDomain(DomainStart=A, DomainEnd=expr("1-x", A))
subcrv = SubCurve(BaseCurve=reparameterize(C), Domain=dom)
C_2 = ClusterOutput(subcrv)

# ==== cluster 余弦曲线
crv = ClusterInput()
crv_2 = Curve(graft(crv))
flip = FlipCurve(Curve=crv_2)  # -> Curve, Flag
切换开关 = 切换开关(输入=[crv_2, flip.Curve], 开关=Toggle(False))  # -> A, B
高度 = ClusterInput()
高度_2 = ClusterInput()
number_slider = Slider(48, range=0..1000)
multiplication = Multiplication(A=高度_2, B=0.5)
divide = DivideCurve(Curve=切换开关.A, Count=number_slider, Kinks=False)  # -> Points, Tangents, Parameters
multiplication_2 = Multiplication(A=multiplication)
cluster = 余弦映射(个数=number_slider, 周期数=高度, 倍率=multiplication)
pdecon = Deconstruct(Point=divide.Points)  # -> XComponent, YComponent, ZComponent
neg = Negative(Value=multiplication_2)
addition = Addition(A=pdecon.ZComponent, B=cluster)
Z = UnitZ(Factor=neg)
pt = ConstructPoint(XCoordinate=pdecon.XComponent, YCoordinate=pdecon.YComponent, ZCoordinate=addition)
midpt = CurveMiddle(Curve=crv_2)
move = Move(Geometry=pt, Motion=Z)  # -> Geometry, Transform
xy = XYPlane(Origin=midpt)
nurbs = NurbsCurve(Vertices=move.Geometry, Degree=3, Periodic=False)  # -> Curve, Length, Domain
mirror = Mirror(Geometry=nurbs.Curve, Plane=xy)  # -> Geometry, Transform
C = ClusterOutput(nurbs.Curve)
G = ClusterOutput(mirror.Geometry)

# ==== cluster 映射: 区间映射
A = ClusterInput()
B = ClusterInput()
V = ClusterInput()
dom = ConstructDomain(DomainStart=A, DomainEnd=B)
bnd = Bounds(Numbers=V)  # -> flatten(Domain)
remap = RemapNumbers(Value=V, Source=bnd, Target=dom)  # -> Mapped, Clipped
R = ClusterOutput(remap.Mapped)

# ==== cluster 余弦映射
个数 = ClusterInput()
周期数 = ClusterInput()
倍率 = ClusterInput()
multiplication = Multiplication(A=周期数, B=Slider(360, range=0..1000))
series = Series(Start=0, Step=1, Count=expr("x+1", 个数))
division = Division(A=multiplication, B=个数)
multiplication_2 = Multiplication(A=division, B=series)
cos = Cosine(Value=degrees(multiplication_2))
multiplication_3 = Multiplication(A=cos, B=倍率)
R = ClusterOutput(multiplication_3)

# ==== cluster 切换开关
开关 = ClusterInput()
panel = Panel("""1
0""")
dispatch = Dispatch(List=panel, DispatchPattern=开关)  # -> ListA, ListB
输入 = ClusterInput()
not = GateNot(A=dispatch.ListB)
dispatch_2 = Dispatch(List=输入, DispatchPattern=[not, dispatch.ListA])  # -> ListA, ListB
A = ClusterOutput(dispatch_2.ListA)
B = ClusterOutput(dispatch_2.ListB)
