# Grasshopper definition 0414幼儿园.gh (Grasshopper 1.0.7)
# plug-ins: Human

crv = Curve([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])
crv_2 = Curve(<curve referenced from the Rhino model>)
crv_3 = Curve(graft(crv))
number_slider = Slider(0.2, range=0..1)  # disabled
brep = Brep(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)  # disabled
previewlw = CustomPreviewLineweights(Geometry=crv_2, Shader=ColourSwatch(SwatchColor=RGB(255, 0, 0)), Thickness=Slider(4, range=0..10), Absolute=False)
previewlw_2 = CustomPreviewLineweights(Geometry=crv_3, Shader=ColourSwatch(SwatchColor=RGB(0, 221, 255)), Thickness=Slider(4, range=0..10), Absolute=False)
len = Length(Curve=crv_3)
number_slider_2 = Slider(0.1, range=0..0.1)  # disabled
# 格栅间距
number_slider_3 = Slider(0.4, range=0..10)
contour = Contour(Shape=brep, Point=Point(0, 0, 0), Direction=Vector(0, 0, 1), Distance=number_slider)  # disabled
boundary = BoundarySurfaces(Edges=contour)  # disabled
neg = Negative(Value=number_slider_2)  # disabled
division = Division(A=len, B=number_slider_3)
Z = UnitZ(Factor=neg)  # disabled
# 格栅尺寸
number_slider_4 = Slider(0.36, range=0..1)
extr = Extrude(Base=boundary, Direction=Z)  # disabled
divide = DivideCurve(Curve=crv_3, Count=division, Kinks=False)  # -> Points, Tangents, Parameters
swatch = ColourSwatch(SwatchColor=RGB(255, 255, 255))  # disabled
preview = CustomPreview(Geometry=extr, Material=swatch)  # disabled
xy = XYPlane(Origin=divide.Points)
rectangle = Rectangle(Plane=PlaneXY(0, 0, 0), XSize=Slider(0.1, range=0..1), YSize=number_slider_4, Radius=0)  # -> Rectangle, Length
align = AlignPlane(Plane=xy, Direction=divide.Tangents)  # -> Plane, Angle
line = LineSDL(Start=divide.Points, Direction=Vector(0, 0, 1), Length="50")
brep_2 = Brep(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)
orient = Orient(Geometry=rectangle.Rectangle, Source=PlaneXY(0, 0, 0), Target=align.Plane)  # -> Geometry, Transform
blx = BrepLine(Brep=brep_2, Line=line, LimitToFirst=False)  # -> Curves, Points
boundary_2 = BoundarySurfaces(Edges=orient.Geometry)
pshift = ShiftPaths(Data=blx.Points, Offset=-1)
dist = Distance(PointA=divide.Points, PointB=pshift)
Z_2 = UnitZ(Factor=dist)
extr_2 = Extrude(Base=boundary_2, Direction=Z_2)  # -> flatten(Extrusion)
# 随机因子
number_slider_5 = Slider(6, range=0..10)
# 删除百分比
number_slider_6 = Slider(0.25, range=0..1)
lng = ListLength(List=extr_2)
jitter = Jitter(List=extr_2, Jitter=1, Seed=number_slider_5)  # -> Values, Indices
multiplication = Multiplication(A=lng, B=number_slider_6)
series = Series(Start=0, Step=1, Count=multiplication)
cull_i = CullIndex(List=jitter.Values, Indices=series, Wrap=True)
preview_2 = CustomPreview(Geometry=cull_i, Material=ColourSwatch(SwatchColor=RGB(255, 255, 255)))
