# Grasshopper definition 0422干扰.gh (Grasshopper 1.0.7)
# plug-ins: Bifocals

number_slider = Slider(12, range=0..100)
number_slider_2 = Slider(12, range=0..100)
series = Series(Start="1", Step=1, Count=number_slider)
series_2 = Series(Start="4", Step=Slider(5, range=0..10), Count=number_slider)
series_3 = Series(Start="1", Step=1, Count=number_slider_2)
series_4 = Series(Start="4", Step=Slider(5, range=0..10), Count=number_slider_2)
cir = Circle(Plane=PlaneXY(0, 0, 0), Radius=series)
cir_2 = Circle(Plane=PlaneXY(0, 0, 0), Radius=series_3)
divide = DivideCurve(Curve=cir_2, Count=series_4, Kinks=False)  # -> flatten(Points), Tangents, Parameters
seam = Seam(Curve=reparameterize(cir), Seam=Slider(0.12, range=0..1))
divide_2 = DivideCurve(Curve=seam, Count=series_2, Kinks=False)  # -> flatten(Points), Tangents, Parameters
item = ListItem(List=cir_2, Index="-1", Wrap=True)
item_2 = ListItem(List=cir, Index="-1", Wrap=True)
divide_3 = DivideCurve(Curve=item, Count="3", Kinks=False)  # -> Points, Tangents, Parameters
divide_4 = DivideCurve(Curve=item_2, Count="3", Kinks=False)  # -> Points, Tangents, Parameters
pt = ConstructPoint(XCoordinate=0, YCoordinate=0, ZCoordinate=0)
pt_2 = ConstructPoint(XCoordinate=0, YCoordinate=0, ZCoordinate=0)
ln = Line(StartPoint=divide_3.Points, EndPoint=pt)
ln_2 = Line(StartPoint=divide_4.Points, EndPoint=pt_2)
rotate = Rotate(Geometry=ln, Angle=degrees(Slider(24, range=0..100)), Plane=PlaneXY(0, 0, 0))  # -> Geometry, Transform
pull = PullPoint(Point=divide_2.Points, Geometry=ln_2, ClosestOnly=True)  # -> ClosestPoint, Distance
pull_2 = PullPoint(Point=divide.Points, Geometry=rotate.Geometry, ClosestOnly=True)  # -> ClosestPoint, Distance
dom = ConstructDomain(DomainStart=Slider(0.1, range=0..1), DomainEnd=Slider(0.4, range=0..1))
dom_2 = ConstructDomain(DomainStart=Slider(0.1, range=0..1), DomainEnd=Slider(0.4, range=0..1))
bnd = Bounds(Numbers=pull.Distance)
bnd_2 = Bounds(Numbers=pull_2.Distance)
remap = RemapNumbers(Value=pull.Distance, Source=bnd, Target=dom)  # -> Mapped, Clipped
remap_2 = RemapNumbers(Value=pull_2.Distance, Source=bnd_2, Target=dom_2)  # -> Mapped, Clipped
cir_3 = Circle(Plane=divide_2.Points, Radius=remap.Mapped)
cir_4 = Circle(Plane=divide.Points, Radius=remap_2.Mapped)
srf = Surface(cir_3)
srf_2 = Surface(cir_4)
