# Grasshopper definition 地形处理.gh (Grasshopper 1.0.7)
# plug-ins: Section To XY, Human

number_slider = Slider(57, range=0..100)
srf = Surface(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)
number_slider_2 = Slider(8, range=0..10)
crv = Curve(<curve referenced from the Rhino model>)
mesh = MeshBrep(
    Brep=srf,
    Settings={GridMaxCount=0, GridMinCount=16, JaggedSeams=False, MaxEdgeLength=0, MinEdgeLength=0.0001, MinTolerance=0, Refine=True, RefineAngle=0, RelativeTolerance=0.65, SimplePlanes=True, Tolerance=0})
余弦曲线 = 余弦曲线(crv=crv, 高度=Slider(0.5, range=0..1), 高度_2=Slider(25.61, range=0..100))  # -> G, C
remesh_random = RemeshRandom(Mesh=mesh, Grid=number_slider_2)
remesh_triangular = RemeshTriangular(Mesh=mesh, Grid=number_slider_2)
number_slider_3 = Slider(200, range=0..1000)
crv_2 = Curve([<curve referenced from the Rhino model> x2])
divide = DivideCurve(Curve=crv_2, Count=Slider(72, range=0..100), Kinks=False)  # -> Points, Tangents, Parameters
pline = PolyLine(Vertices=divide.Points, Closed=True)  # -> flatten(Polyline)
mesh_flat = MeshFlat(Mesh=remesh_random, Curve=crv_2, Width=Slider(50, range=0..100))
crv_3 = Curve([<curve referenced from the Rhino model> x2])
mesh_path = MeshPath(Mesh=mesh_flat, Curve=crv_3, Width=Slider(8, range=0..10))
remesh_random_2 = RemeshRandom(Grid=Slider(8, range=0..10))
crv_4 = Curve([<curve referenced from the Rhino model> x276])
brep = Brep(<brep referenced from the Rhino model>)
project = Project(Curve=crv_4, Brep=brep, Direction=Vector(0, 0, 1))
dpipeline = DynamicGeometryPipeline(
    LayerFilter="景观",
    TypeFilter="curve",
    NameFilter="*",
    GroupByLayer=False,
    GroupByType=False,
    IncludeHidden=True,
    IncludeLocked=True,
    enableFullPath=False,
    listenToAttributes=True)
previewlw = CustomPreviewLineweights(Geometry=project, Shader=ColourSwatch(SwatchColor=RGB(0, 0, 0)), Thickness=Slider(2, range=0..10), Absolute=False)
previewlw_2 = CustomPreviewLineweights(Geometry=dpipeline, Shader=ColourSwatch(SwatchColor=RGB(255, 0, 0)), Thickness=Slider(3, range=0..10), Absolute=False)

# ==== cluster 余弦曲线
crv = ClusterInput()
crv_2 = Curve(graft(crv))
flip = FlipCurve(Curve=crv_2)  # -> Curve, Flag
切换开关 = 切换开关(输入=[crv_2, flip.Curve], 开关=Toggle(False))  # -> A, B
高度 = ClusterInput()
高度_2 = ClusterInput()
number_slider = Slider(48, range=0..1000)
multiplication = Multiplication(A=高度_2, B=0.5)
divide = DivideCurve(Curve=切换开关.A, Count=number_slider, Kinks=False)  # -> Points, Tangents, Parameters
multiplication_2 = Multiplication(A=multiplication)
cluster = 余弦映射(个数=number_slider, 周期数=高度, 倍率=multiplication)
pdecon = Deconstruct(Point=divide.Points)  # -> XComponent, YComponent, ZComponent
neg = Negative(Value=multiplication_2)
addition = Addition(A=pdecon.ZComponent, B=cluster)
Z = UnitZ(Factor=neg)
pt = ConstructPoint(XCoordinate=pdecon.XComponent, YCoordinate=pdecon.YComponent, ZCoordinate=addition)
midpt = CurveMiddle(Curve=crv_2)
move = Move(Geometry=pt, Motion=Z)  # -> Geometry, Transform
xy = XYPlane(Origin=midpt)
nurbs = NurbsCurve(Vertices=move.Geometry, Degree=3, Periodic=False)  # -> Curve, Length, Domain
mirror = Mirror(Geometry=nurbs.Curve, Plane=xy)  # -> Geometry, Transform
C = ClusterOutput(nurbs.Curve)
G = ClusterOutput(mirror.Geometry)

# ==== cluster 余弦映射
个数 = ClusterInput()
周期数 = ClusterInput()
倍率 = ClusterInput()
multiplication = Multiplication(A=周期数, B=Slider(360, range=0..1000))
series = Series(Start=0, Step=1, Count=expr("x+1", 个数))
division = Division(A=multiplication, B=个数)
multiplication_2 = Multiplication(A=division, B=series)
cos = Cosine(Value=degrees(multiplication_2))
multiplication_3 = Multiplication(A=cos, B=倍率)
R = ClusterOutput(multiplication_3)

# ==== cluster 切换开关
开关 = ClusterInput()
panel = Panel("""1
0""")
dispatch = Dispatch(List=panel, DispatchPattern=开关)  # -> ListA, ListB
输入 = ClusterInput()
not = GateNot(A=dispatch.ListB)
dispatch_2 = Dispatch(List=输入, DispatchPattern=[not, dispatch.ListA])  # -> ListA, ListB
A = ClusterOutput(dispatch_2.ListA)
B = ClusterOutput(dispatch_2.ListB)
